vi "alantan_decode.gvi"   [LabVIEW NXG]
inputs:
  "Modulation Parameters In": T6 = {"Modulation Type"="QPSK", "Control Information\nfor Packet Header/Tail"={"Training Sequence (derived)"=[], "Zero Pad Length"=0}, "RX Oversample Factor"=20, "Synchronization Options"={"Synchronization Method"="Timing Estimation", "Fixed Offset"=0, "Symbol Timing Recovery Method"="Max Energy", "Frame Detection Method"="Sliding Correlator", "Correct Frequency Offset"=FALSE}, "Number of Data Symbols (Derived)"=100, "RX Sample Rate"=4000000, "Pulse Shaping Parameters"={"Modulation Type"="PSK", "Pulse Shaping Filter"="Root Raised Cos", "Filter Parameter"=0.5, "Filter Length (Symbols)"=8}, "Channel Estimation/Equalization Parameters"={"Equalization Method"="Direct", "Channel Estimate Length"=1, "Equalizer Length"=1, "Equalizer Delay"=-1}}
  "Input Symbols": c128[]
  "error in (no error)": error
outputs:
  "Modulation Parameters Out": T6
  "Decoded Bit Stream": u8[]
  "error out": error
types:
  T1 = cluster{"Training Sequence (derived)": c128[], "Zero Pad Length": i32}
  T2 = cluster{"Synchronization Method": string, "Fixed Offset": i32, "Symbol Timing Recovery Method": string, "Frame Detection Method": string, "Correct Frequency Offset": bool}
  T3 = enum{"none", "Raised Cosine", "Root Raised Cos", "Gaussian"}
  T4 = cluster{"Modulation Type": enum{"FSK", "PSK", "QAM", "MSK", "PAM", "ASK"}, "Pulse Shaping Filter": T3, "Filter Parameter": f64, "Filter Length (Symbols)": i32}
  T5 = cluster{"Equalization Method": string, "Channel Estimate Length": i32, "Equalizer Length": i32, "Equalizer Delay": i32}
  T6 = cluster{"Modulation Type": string, "Control Information\nfor Packet Header/Tail": T1, "RX Oversample Factor": i32, "Synchronization Options": T2, "Number of Data Symbols (Derived)": i32, "RX Sample Rate": f64, "Pulse Shaping Parameters": T4, "Channel Estimation/Equalization Parameters": T5}
diagram:
  $"Modulation Parameters Out" <- $"Modulation Parameters In"
  Array Size(array=$"Input Symbols") -> (size(s)=w1)
  Property Node(instance in=$"Modulation Parameters In") -> ("Modulation Type"=w2)
  case (w2) {
    frame "False", Default {
      # error
      #
      # send a specil array to out
      w3 = [0, 1, 2, 3, 4]
    }
    frame "BPSK" {
      # BPSK
      for (N = w1) {
        w4 = each element of $"Input Symbols"
        Complex To Real Imaginary(x + iy=w4) -> (x=w5)
        Is Greater Than 0(x=w5) -> w6
        # For each recieved symbol
        # if input is >=0 , we recieved a 0
        # if input is < 0 , we recieved a 1
        case (w6) {
          frame False, Default {
            w7 = 1
          }
          frame True {
            w7 = 0
          }
        }
        append w7 to w3
      }
    }
    frame "QPSK" {
      # QPSK
      # for each received symbol
      s1 = u8[] []  # shift register
      for (N = w1) {
        w8 = each element of $"Input Symbols"
        Complex To Real Imaginary(x + iy=w8) -> (x=w9, y=w10)
        Is Greater Than 0(x=w9) -> w11
        Is Greater Than 0(x=w10) -> w12
        case (w11) {
          frame False, Default {
            # Re{sym} < 0
            case (w12) {
              frame False, Default {
                # Im{sym} <0
                #
                # therefore
                # bits = 11
                Build Array(1, 1) -> w13
              }
              frame True {
                # Im{sym} >= 0
                #
                # therefore
                # bits = 01
                Build Array(1, 0) -> w13
              }
            }
          }
          frame True {
            # Re{sym} >= 0
            case (w12) {
              frame False, Default {
                # Im{sum} < 0
                #
                # therefore
                # bits = 10
                Build Array(0, 1) -> w13
              }
              frame True {
                # Im{sym} >= 0
                #
                # therefore,
                #
                # bits = 00
                Build Array(0, 0) -> w13
              }
            }
          }
        }
        Array Size(array=s1) -> (size(s)=w14)
        Insert Into Array(inArray=s1, index0=w14, new=w13) -> w15
        next s1 = w15
      }
      w3 = s1
    }
  }
  $"Decoded Bit Stream" <- w3
  $"error out" <- $"error in (no error)"
