vi "alantan_modulate.gvi"   [LabVIEW NXG]
inputs:
  "Modulation Parameters In": T4 = {"Modulation Type"="QPSK", "Pulse Shaping Parameters"={"Modulation Type"="PSK", "Pulse Shaping Filter"="Root Raised Cos", "Filter Parameter"=0.5, "Filter Length (Symbols)"=8}, "TX Oversample Factor"=20, "Packet Length (Bits)"=500, "TX Sample Rate"=100, "Control Information For Packet Header/Tail"={"Training Sequence "="Length 11 Barker Sequence", "Zero Pad Length"=8}}
  "input bit stream": u8[]
  "Error In": error
  "Symbol Energy (1)": f64 = 1
outputs:
  "Modulation Parameters Out": T4
  "output symbols": c128[]
  "Error Out": error
types:
  T1 = enum{"none", "Raised Cosine", "Root Raised Cos", "Gaussian"}
  T2 = cluster{"Modulation Type": enum{"FSK", "PSK", "QAM", "MSK", "PAM", "ASK"}, "Pulse Shaping Filter": T1, "Filter Parameter": f64, "Filter Length (Symbols)": i32}
  T3 = cluster{"Training Sequence ": string, "Zero Pad Length": i32}
  T4 = cluster{"Modulation Type": string, "Pulse Shaping Parameters": T2, "TX Oversample Factor": i32, "Packet Length (Bits)": i32, "TX Sample Rate": f64, "Control Information For Packet Header/Tail": T3}
diagram:
  $"Modulation Parameters Out" <- $"Modulation Parameters In"
  Array Size(array=$"input bit stream") -> (size(s)=w1)
  # Avg symbol energy is related to the <>
  # Square of the symbol magnitude.
  # Avg Magnitude
  Square Root(x=$"Symbol Energy (1)") -> w2
  Property Node(instance in=$"Modulation Parameters In") -> ("Modulation Type"=w3)
  case (w3) {
    frame "Error", Default {
      # special error symbol sequence
      w4 = [0+0i, 1+1i, 2+2i, 3+3i, 4+4i]
    }
    frame "BPSK" {
      # BPSK implementation
      # Loop through each bit in input
      for (N = w1) {
        w5 = each element of $"input bit stream"
        # If bit == 1 ==>out symbol = neg
        # if bit == 0 ==> out symbol = pos
        case (w5) {
          frame 1, Default {
            Multiply(w2, -1+0i) -> w6
          }
          frame 0 {
            w6 = w2
          }
        }
        append w6 to w4
      }
    }
    frame "QPSK" {
      Quotient And Remainder(x=w1, y=2) -> (floor(x/y)=w7)
      Square Root(x=2) -> w8
      Multiply(w2, w8) -> w9
      # QPSK implementation
      # only need half as
      # many iterations
      # because we grab
      # 2 values at a time
      # lopp through each bit input
      # get x,y component
      # value
      for (N = w7) (iteration -> i1) {
        Multiply(i1, 2) -> w10
        # first bit
        Array Index(array=$"input bit stream") -> (out0[w10]=w11)
        Increment(x=w10) -> w12
        # second bit
        Array Index(array=$"input bit stream") -> (out0[w12]=w13)
        Multiply(w13, 10) -> w14
        Add(w11, w14) -> w15: i32
        # Key:
        # 0  : 00
        # 1  : 10
        # 10: 01
        # 11: 11
        case (w15) {
          frame Default {
            # error case,
            # output 10+10j
            # as our symbol
            w16 = 100+100i
          }
          frame 0 {
            Multiply(w9, 1) -> w17
            Multiply(w9, 1) -> w18
            Real And Imaginary To Complex(x=w17, y=w18) -> w16
          }
          frame 1 {
            Multiply(w9, -1) -> w19
            Multiply(w9, 1) -> w20
            Real And Imaginary To Complex(x=w19, y=w20) -> w16
          }
          frame 11 {
            Multiply(w9, -1) -> w21
            Multiply(w9, -1) -> w22
            Real And Imaginary To Complex(x=w21, y=w22) -> w16
          }
          frame 10 {
            Multiply(w9, 1) -> w23
            Multiply(w9, -1) -> w24
            Real And Imaginary To Complex(x=w23, y=w24) -> w16
          }
        }
        append w16 to w4
      }
    }
  }
  $"output symbols" <- w4
  $"Error Out" <- $"Error In"
