vi "receiver.gvi"   [LabVIEW NXG]
inputs:
  "HW Parameters In": T3 = {"Active Antenna"="RX1", "Carrier Frequency (Hz)"=915000000, "Gain (dB)"=10, "Trigger Level"=0.01, "Bandwidth (Hz)"=40000000, "Reference Position (%)"=10, "Capture Time (s)"=0.002, "Simulate"=FALSE, "Device IP Address"="192.168.10.2"}
  "Modulation Parameters In": T10 = {"Modulation Type"="QPSK", "Control Information\nfor Packet Header/Tail"={"Training Sequence (derived)"=[], "Zero Pad Length"=0}, "RX Oversample Factor"=20, "Synchronization Options"={"Synchronization Method"="Timing Estimation", "Fixed Offset"=0, "Symbol Timing Recovery Method"="Max Energy", "Frame Detection Method"="Sliding Correlator", "Correct Frequency Offset"=FALSE}, "Number of Data Symbols (Derived)"=250, "RX Sample Rate"=4000000, "Pulse Shaping Parameters"={"Modulation Type"="PSK", "Pulse Shaping Filter"="Raised Cosine", "Filter Parameter"=0.5, "Filter Length (Symbols)"=8}, "Channel Estimation/Equalization Parameters"={"Equalization Method"="Direct", "Channel Estimate Length"=4, "Equalizer Length"=4, "Equalizer Delay"=-1}}
  "Queues In": T2
  "error in (no error)": error
  "Input Complex Waveform": cluster{"t0": f64, "dt": f64, "Y": c128[]}
outputs:
  "error out": error
  "Modulation Parameters Out": T10
  "HW Parameters Out": T3
  "Queues Out": T2
  "RX waveforms out": T4
  "Overhead Offset": i32
  "Symbol Rate": f64
  "Bit-Error Rate": f64
  "Offset": i32
  "Key Bit Sequence": i8[]
  "Measured channel impairements": T1
types:
  T1 = cluster{"SNR(dB)": f64, "Channel Estimate": c128[], "Frequency Offset": f64, "Delay": f64}
  T2 = cluster{"Element 1": Queue<u8[]>, "Element 2": Queue<c128[]>}
  T3 = cluster{"Active Antenna": string, "Carrier Frequency (Hz)": f64, "Gain (dB)": f64, "Trigger Level": f64, "Bandwidth (Hz)": f64, "Reference Position (%)": f64, "Capture Time (s)": f64, "Simulate": bool, "Device IP Address": string}
  T4 = cluster{"Eye Diagram": cluster{"t0": f64, "dt": f64, "Y": f64[]}[], "Power Delay Profile": DoubleAnalogWaveform, "IQ Graph": cluster{"Element 1": f64[], "Element 2": f64[]}[]}
  T5 = cluster{"Training Sequence (derived)": c128[], "Zero Pad Length": i32}
  T6 = cluster{"Synchronization Method": string, "Fixed Offset": i32, "Symbol Timing Recovery Method": string, "Frame Detection Method": string, "Correct Frequency Offset": bool}
  T7 = enum{"none", "Raised Cosine", "Root Raised Cos", "Gaussian"}
  T8 = cluster{"Modulation Type": enum{"FSK", "PSK", "QAM", "MSK", "PAM", "ASK"}, "Pulse Shaping Filter": T7, "Filter Parameter": f64, "Filter Length (Symbols)": i32}
  T9 = cluster{"Equalization Method": string, "Channel Estimate Length": i32, "Equalizer Length": i32, "Equalizer Delay": i32}
  T10 = cluster{"Modulation Type": string, "Control Information\nfor Packet Header/Tail": T5, "RX Oversample Factor": i32, "Synchronization Options": T6, "Number of Data Symbols (Derived)": i32, "RX Sample Rate": f64, "Pulse Shaping Parameters": T8, "Channel Estimation/Equalization Parameters": T9}
diagram:
  $"HW Parameters Out" <- $"HW Parameters In"
  case ($"error in (no error)") {
    frame No Error {
      call "receiver_init (SubVI).gvi"(Modulation Parameters In=$"Modulation Parameters In", Queues In=$"Queues In") -> (Modulation Parameters Out=w3, Queues Out=w2, symbol rate=w4, key bit sequence=w5, overhead offset=w6)
      # 1.Determine the number of data symbols, the symbol rate, the overhead
      # offset, and get the key bit sequence and training sequence from the queue
      $"Symbol Rate" <- w4
      call "matched_filtering.gviprotected"(Modulation Parameters In=w3, Input Complex Waveform=$"Input Complex Waveform", error in (no error)=$"error in (no error)") -> (Modulation Parameters Out=w7, Output Complex Waveform=w8, error out=w9)
      call "synchronize.gviprotected"(Modulation Parameters In=w7, Input Complex Waveform=w8, error in (no error)=w9) -> (Modulation Parameters Out=w10, Output Complex Symbols=w11, Offset=w12, error out=w13, Intermediate Complex Waveform=w14, Estimated Frequency Offset=w15)
      # 2. Process baseband signal
      call "channel_estimate.gviprotected"(Modulation Parameters In=w10, Input Symbol Sequence=w11, error in (no error)=w13) -> (Modulation Parameters Out=w16, Channel Estimate=w17, error out=w18)
      call "equalizer.gviprotected"(Modulation Parameters In=w16, Input=w11, Channel Estimate=w17, error in (no error)=w18) -> (Modulation Parameters Out=w19, Equalized Output=w20, Mean-Squared Error=w21, error out=w22)
      call "strip_control.gviprotected"(Modulation Parameters In=w19, input=w20, error in (no error)=w22) -> (Modulation Parameters Out=w23, data symbols=w24, error out=w25)
      call "receiver_channel_impairments (SubVI).gvi"(Modulation Parameters In=$"Modulation Parameters In", mean-squared error=w21, channel estimate=w17, offset=w12, estimated frequency offset=w15, overhead offset=w6) -> (Measured channel impairements=w26)
      call "decode.gviprotected"(Modulation Parameters In=w23, input symbols=w24, error in (no error)=w25) -> (Modulation Parameters Out=w27, decoded bit stream=w28, error out=w29)
      # 1.Determine the number of data symbols and get the key bit sequence and training sequence from the queue
      # 2. Process baseband signal
      # 3. Plot the symbol constellation and eye diagram for recovered symbols
      # 3. Plot the symbol constellation and eye diagram for recovered symbols
      # recovered symbols
      call "receiver_generate_waveforms (SubVI).gvi"(Modulation Parameters In=w27, Intermediate Complex Waveform=w14, Data Symbols=w24, Measured Channel Impairements=w26) -> (Modulation Parameters Out=w30, RX Waveforms Out=w31)
      $"RX waveforms out" <- w31
      $"Measured channel impairements" <- w26
      # key bit sequence
      $Offset <- w12
      call "error_detect.gviprotected"(input bit sequence=w28, key bit sequence=w5, error in (no error)=w29) -> (bit-error rate=w32, error out=w1)
      $"Bit-Error Rate" <- w32
      $"Key Bit Sequence" <- w5
      $"Overhead Offset" <- w6
    }
    frame Error {
      w1 = $"error in (no error)"
      w2 = $"Queues In"
    }
  }
  $"error out" <- w1
  $"Queues Out" <- w2
