vi "student_EL_crossing.gvi"   [LabVIEW NXG]
inputs:
  "M": i32
  "J[k]": f64[]
outputs:
  "found k": i32
diagram:
  # array of k values that
  # we have visited
  Multiply($M, 2) -> w1
  Initialize Array(element=FALSE, size=w1) -> w2
  # initial guess of k
  s1 = w2  # shift register
  s2 = 0  # shift register
  while {
    Array Index(array=s1) -> (out0[s2]=w3)
    Quotient And Remainder(x=s2, y=$M) -> (x-y*floor(x/y)=w4)
    Array Index(array=$"J[k]") -> (out0[w4]=w5)
    Is Greater Than 0(x=w5) -> w6
    Decrement(x=s2) -> w7
    Increment(x=s2) -> w8
    Select(s=w6, t=w8, f=w7) -> w9
    Quotient And Remainder(x=w9, y=w1) -> (x-y*floor(x/y)=w10)
    Select(s=w3, t=s2, f=w10) -> w11
    Replace Array Subset(inArray=s1, s2, TRUE) -> w12
    next s1 = w12
    next s2 = w11
    stop if w3
  }
  Quotient And Remainder(x=s2, y=$M) -> (x-y*floor(x/y)=w13)
  $"found k" <- w13
