vi "student_align_ELgate.gvi"   [LabVIEW NXG]
inputs:
  "Modulation Parameters In": T6 = {"Modulation Type"="QPSK", "Control Information\nfor Packet Header/Tail"={"Training Sequence (derived)"=[], "Zero Pad Length"=0}, "RX Oversample Factor"=20, "Synchronization Options"={"Synchronization Method"="Timing Estimation", "Fixed Offset"=0, "Symbol Timing Recovery Method"="Max Energy", "Frame Detection Method"="Sliding Correlator", "Correct Frequency Offset"=FALSE}, "Number of Data Symbols (Derived)"=100, "RX Sample Rate"=4000000, "Pulse Shaping Parameters"={"Modulation Type"="PSK", "Pulse Shaping Filter"="Root Raised Cos", "Filter Parameter"=0.5, "Filter Length (Symbols)"=8}, "Channel Estimation/Equalization Parameters"={"Equalization Method"="Direct", "Channel Estimate Length"=1, "Equalizer Length"=1, "Equalizer Delay"=-1}}
  "Input Complex Waveform": cluster{"t0": f64, "dt": f64, "Y": c128[]} = {"t0"=0, "dt"=1, "Y"=[]}
  "Error In": error
outputs:
  "Modulation Parameters Out": T6
  "Aligned Complex Waveform": cluster{"t0": f64, "dt": f64, "Y": c128[]}
  "Error Out": error
  "Alignment Offset (Samples)": i32
types:
  T1 = cluster{"Training Sequence (derived)": c128[], "Zero Pad Length": i32}
  T2 = cluster{"Synchronization Method": string, "Fixed Offset": i32, "Symbol Timing Recovery Method": string, "Frame Detection Method": string, "Correct Frequency Offset": bool}
  T3 = enum{"none", "Raised Cosine", "Root Raised Cos", "Gaussian"}
  T4 = cluster{"Modulation Type": enum{"FSK", "PSK", "QAM", "MSK", "PAM", "ASK"}, "Pulse Shaping Filter": T3, "Filter Parameter": f64, "Filter Length (Symbols)": i32}
  T5 = cluster{"Equalization Method": string, "Channel Estimate Length": i32, "Equalizer Length": i32, "Equalizer Delay": i32}
  T6 = cluster{"Modulation Type": string, "Control Information\nfor Packet Header/Tail": T1, "RX Oversample Factor": i32, "Synchronization Options": T2, "Number of Data Symbols (Derived)": i32, "RX Sample Rate": f64, "Pulse Shaping Parameters": T4, "Channel Estimation/Equalization Parameters": T5}
diagram:
  $"Modulation Parameters Out" <- $"Modulation Parameters In"
  Property Node(instance in=$"Input Complex Waveform") -> ("Y"=w1)
  Property Node(instance in=$"Modulation Parameters In") -> ("RX Oversample Factor"=w2)
  # M
  for (N = w2) (iteration -> i1) {
    Array Size(array=w1) -> (size(s)=w4)
    Quotient And Remainder(x=w4, y=w2) -> (floor(x/y)=w5)
    # K.
    s1 = 0  # shift register
    for (N = w5) (iteration -> i2) {
      Multiply(w2, i2) -> w6
      Add(w6, i1) -> w7
      Array Index(array=w1) -> (out0[w7]=w8)
      Add(w7, 1) -> w9
      Array Index(array=w1) -> (out0[w9]=w10)
      Complex Conjugate(x + iy=w10) -> w11
      # N.
      Subtract(x=w7, y=1) -> w12
      Array Index(array=w1) -> (out0[w12]=w13)
      Complex Conjugate(x + iy=w13) -> w14
      Subtract(x=w11, y=w14) -> w15
      Multiply(w8, w15) -> w16
      Complex To Real Imaginary(x + iy=w16) -> (x=w17)
      Multiply(w17, 2) -> w18
      Add(w18, s1) -> w19
      next s1 = w19
    }
    append s1 to w3
  }
  call "student_EL_crossing.gvi"(M=w2, J[k]=w3) -> (found k=w20)
  Multiply(w20, -1) -> w21
  Rotate 1D Array(array=w1, n=w21) -> (array (last n elements first)=w22)
  Property Node(instance in=$"Input Complex Waveform", "Y"=w22) -> (instance out=w23)
  $"Aligned Complex Waveform" <- w23
  $"Alignment Offset (Samples)" <- w20
  $"Error Out" <- $"Error In"
