vi "student_align_MaxEnergy.gvi"   [LabVIEW NXG]
inputs:
  "Modulation Parameters In": T6 = {"Modulation Type"="QPSK", "Control Information\nfor Packet Header/Tail"={"Training Sequence (derived)"=[], "Zero Pad Length"=0}, "RX Oversample Factor"=20, "Synchronization Options"={"Synchronization Method"="Timing Estimation", "Fixed Offset"=0, "Symbol Timing Recovery Method"="Max Energy", "Frame Detection Method"="Sliding Correlator", "Correct Frequency Offset"=FALSE}, "Number of Data Symbols (Derived)"=100, "RX Sample Rate"=4000000, "Pulse Shaping Parameters"={"Modulation Type"="PSK", "Pulse Shaping Filter"="Root Raised Cos", "Filter Parameter"=0.5, "Filter Length (Symbols)"=8}, "Channel Estimation/Equalization Parameters"={"Equalization Method"="Direct", "Channel Estimate Length"=1, "Equalizer Length"=1, "Equalizer Delay"=-1}}
  "Input Complex Waveform": cluster{"t0": f64, "dt": f64, "Y": c128[]} = {"t0"=0, "dt"=1, "Y"=[]}
  "Error In": error
outputs:
  "Modulation Parameters Out": T6
  "Aligned Complex Waveform": cluster{"t0": f64, "dt": f64, "Y": c128[]}
  "Error Out": error
  "Alignment Offset (Samples)": i32
types:
  T1 = cluster{"Training Sequence (derived)": c128[], "Zero Pad Length": i32}
  T2 = cluster{"Synchronization Method": string, "Fixed Offset": i32, "Symbol Timing Recovery Method": string, "Frame Detection Method": string, "Correct Frequency Offset": bool}
  T3 = enum{"none", "Raised Cosine", "Root Raised Cos", "Gaussian"}
  T4 = cluster{"Modulation Type": enum{"FSK", "PSK", "QAM", "MSK", "PAM", "ASK"}, "Pulse Shaping Filter": T3, "Filter Parameter": f64, "Filter Length (Symbols)": i32}
  T5 = cluster{"Equalization Method": string, "Channel Estimate Length": i32, "Equalizer Length": i32, "Equalizer Delay": i32}
  T6 = cluster{"Modulation Type": string, "Control Information\nfor Packet Header/Tail": T1, "RX Oversample Factor": i32, "Synchronization Options": T2, "Number of Data Symbols (Derived)": i32, "RX Sample Rate": f64, "Pulse Shaping Parameters": T4, "Channel Estimation/Equalization Parameters": T5}
diagram:
  $"Modulation Parameters Out" <- $"Modulation Parameters In"
  Property Node(instance in=$"Input Complex Waveform") -> ("Y"=w1)
  # M
  Property Node(instance in=$"Modulation Parameters In") -> ("RX Oversample Factor"=w2)
  Property Node(instance in=$"Input Complex Waveform") -> ("Y"=w3)
  Array Size(array=w3) -> (size(s)=w4)
  # # of elements
  # to avg =
  # size(array)/M
  Quotient And Remainder(x=w4, y=w2) -> (floor(x/y)=w5)
  # Array that holds the avg powers for
  # k = 0, 1, ... , M -1
  for (N = w2) (iteration -> i1) {
    # Try delays k = 0, 1, 2, ... , M -1
    # M is oversample factor
    # k value
    # Initial Sum
    s1 = 0  # shift register
    for (N = w5) (iteration -> i2) {
      # Sum up the energy of every kth value
      # Sum{nM +k}
      # n
      Multiply(i2, w2) -> w7
      # nM + k
      Add(w7, i1) -> w8
      Array Index(array=w3) -> (out0[w8]=w9)
      Absolute Value(x=w9) -> w10
      # energy of array[nM +k]
      Square(x=w10) -> w11
      Add(w11, s1) -> w12
      next s1 = w12
    }
    # divide by total #
    # of elements
    # (finding avg)
    Divide(x=s1, y=w5) -> w13
    append w13 to w6
  }
  # find the kth index with
  # the max avg energy
  # This is our best delay k
  Array Max And Min(array=w6) -> (max index(es)=w14)
  Negate(x=w14) -> w15
  # advance by k (rotate left), using "rotate" VI.
  # the k samples rotated to the end of
  # the array are thrown away during
  # downsample.
  Rotate 1D Array(array=w1, n=w15) -> (array (last n elements first)=w16)
  Property Node(instance in=$"Input Complex Waveform", "Y"=w16) -> (instance out=w17)
  $"Aligned Complex Waveform" <- w17
  $"Alignment Offset (Samples)" <- w14
  $"Error Out" <- $"Error In"
