vi "student_LLSE.gvi"   [LabVIEW NXG]
inputs:
  "Error In": error
  "A": c128[][]
  "b": c128[]
outputs:
  "Error Out": error
  "x.estimate": c128[]
  "mean square error": f64
diagram:
  # NOTE: A* is conjugate transpose of A
  Complex Conjugate(x + iy=$A) -> w1
  # A*
  call "Complex Conjugate Transpose Matrix.gvi"(input matrix=w1) -> (matrix conjugate transpose=w2)
  # (A* A)
  call "Complex A x B.gvi"(A=w2, B=$A) -> (A x B=w3)
  # (A* A)^-1
  call "Complex Inverse Matrix.gvi"(input matrix=w3) -> (inverse matrix=w4, error=w5)
  # ((A* A)^-1) (A*)
  call "Complex A x B.gvi"(A=w4, B=w2) -> (A x B=w6)
  # multiply our matrix with
  # our observed b matrix
  call "Complex A x Vector.gvi"(A=w6, vector=$b) -> (A x vector=w7)
  $"x.estimate" <- w7
  # A*x.est
  call "Complex A x Vector.gvi"(A=$A, vector=w7) -> (A x vector=w8)
  # error
  Subtract(x=w8, y=$b) -> w9
  Absolute Value(x=w9) -> w10
  Square(x=w10) -> w11
  # magnitude squared
  # of error
  Add Array Elements(numeric array=w11) -> (sum=w12)
  $"mean square error" <- w12
  Property Node(instance in=$"Error In", "status"=TRUE, "code"=w5, "source"="Inverse Matrix error in student_LSSE.gvi") -> (instance out=w13)
  Is Equal To 0(x=w5) -> w14
  Select(s=w14, t=$"Error In", f=w13) -> w15
  $"Error Out" <- w15
