vi "student_direct_equalizer.gvi"   [LabVIEW NXG]
inputs:
  "Modulation Parameters In": T6 = {"Modulation Type"="QPSK", "Control Information\nfor Packet Header/Tail"={"Training Sequence (derived)"=[], "Zero Pad Length"=0}, "RX Oversample Factor"=20, "Synchronization Options"={"Synchronization Method"="Timing Estimation", "Fixed Offset"=0, "Symbol Timing Recovery Method"="Max Energy", "Frame Detection Method"="Sliding Correlator", "Correct Frequency Offset"=FALSE}, "Number of Data Symbols (Derived)"=100, "RX Sample Rate"=4000000, "Pulse Shaping Parameters"={"Modulation Type"="PSK", "Pulse Shaping Filter"="Root Raised Cos", "Filter Parameter"=0.5, "Filter Length (Symbols)"=8}, "Channel Estimation/Equalization Parameters"={"Equalization Method"="Direct", "Channel Estimate Length"=1, "Equalizer Length"=1, "Equalizer Delay"=-1}}
  "Input": c128[]
  "Equalizer Delay": i32
  "error in (no error)": error
outputs:
  "Modulation Parameters Out": T6
  "Filter Estimate": c128[]
  "Mean-Squared Error": f64
  "Actual Equalizer Delay": i32
  "error out": error
panel indicators:
  "Error Code": i32
types:
  T1 = cluster{"Training Sequence (derived)": c128[], "Zero Pad Length": i32}
  T2 = cluster{"Synchronization Method": string, "Fixed Offset": i32, "Symbol Timing Recovery Method": string, "Frame Detection Method": string, "Correct Frequency Offset": bool}
  T3 = enum{"none", "Raised Cosine", "Root Raised Cos", "Gaussian"}
  T4 = cluster{"Modulation Type": enum{"FSK", "PSK", "QAM", "MSK", "PAM", "ASK"}, "Pulse Shaping Filter": T3, "Filter Parameter": f64, "Filter Length (Symbols)": i32}
  T5 = cluster{"Equalization Method": string, "Channel Estimate Length": i32, "Equalizer Length": i32, "Equalizer Delay": i32}
  T6 = cluster{"Modulation Type": string, "Control Information\nfor Packet Header/Tail": T1, "RX Oversample Factor": i32, "Synchronization Options": T2, "Number of Data Symbols (Derived)": i32, "RX Sample Rate": f64, "Pulse Shaping Parameters": T4, "Channel Estimation/Equalization Parameters": T5}
diagram:
  $"Modulation Parameters Out" <- $"Modulation Parameters In"
  # filter length, Lf
  Property Node(instance in=$"Modulation Parameters In") -> ("Channel Estimation/Equalization Parameters:Equalizer Length"=w1, "Control Information\nfor Packet Header/Tail:Training Sequence (derived)"=w2)
  Quotient And Remainder(x=$"Equalizer Delay", y=w1) -> (x-y*floor(x/y)=w3)
  $"Actual Equalizer Delay" <- w3
  # Lf + 1
  Increment(x=w1) -> w4
  # find row vector to feed into student_toeplitz.gvi
  for (N = w4) (iteration -> i1) {
    # l
    Subtract(x=$"Equalizer Delay", y=i1) -> w6
    # y[nd - l]
    # from l = 0 to l = Lf filterlength
    # inclusive
    Array Index(array=$Input) -> (out0[w6]=w7)
    append w7 to w5
  }
  # training length, Nt
  Array Size(array=w2) -> (size(s)=w8)
  # find col vector to feed into student_toeplitz.gvi
  for (N = w8) (iteration -> i2) {
    Add(i2, $"Equalizer Delay") -> w10
    # y[nd + k]
    # from k = 0 to k = Nt-1 traning lenth
    # inclusive
    Array Index(array=$Input) -> (out0[w10]=w11)
    append w11 to w9
  }
  call "student_toeplitz.gvi"(Error In=$"error in (no error)", Row=w5, Column=w9) -> (Error Out=w12, Toeplitz Array=w13)
  call "student_LLSE.gvi"(Error In=w12, A=w13, b=w2) -> (Error Out=w14, x.estimate=w15, mean square error=w16)
  $"Filter Estimate" <- w15
  $"Mean-Squared Error" <- w16
  Property Node(instance in=w14) -> ("code"=w17)  # Error Properties
  $"Error Code" <- w17
  $"error out" <- w14
