vi "student_toeplitz.gvi"   [LabVIEW NXG]
inputs:
  "Error In": error
  "Row": c128[]
  "Column": c128[]
outputs:
  "Error Out": error
  "Toeplitz Array": c128[][]
diagram:
  $"Error Out" <- $"Error In"
  Array Size(array=$Row) -> (size(s)=w1)
  Array Size(array=$Column) -> (size(s)=w2)
  Add(w1, w2) -> w3
  Decrement(x=w3) -> w4
  Initialize Array(element=0+0i, size=w4, size=w4) -> w5
  # zero pad the col
  Reshape Array(inArray=$Column, size=w4) -> w6
  # Copy Cols into result array
  s1 = w5  # shift register
  s2 = w6  # shift register
  for (N = w4) (iteration -> i1) {
    Replace Array Subset(inArray=s1, index=_, i1, s2) -> w7
    # After copying the row, shift the row right
    Rotate 1D Array(array=s2, n=1) -> (array (last n elements first)=w8)
    # zero out 1st element
    Replace Array Subset(inArray=w8, 0, 0+0i) -> w9
    next s1 = w7
    next s2 = w9
  }
  # zero pad the row
  Reshape Array(inArray=$Row, size=w4) -> w10
  # Copy rows into result array
  s3 = w5  # shift register
  s4 = w10  # shift register
  for (N = w4) (iteration -> i2) {
    Replace Array Subset(inArray=s3, i2, index=_, s4) -> w11
    # After copying the row, shift the row right
    Rotate 1D Array(array=s4, n=1) -> (array (last n elements first)=w12)
    # zero out 1st element
    Replace Array Subset(inArray=w12, 0, 0+0i) -> w13
    next s3 = w11
    next s4 = w13
  }
  Add(s3, s1) -> w14
  # divide diagonal by half
  # redimension the result array to proper dimensions
  s5 = w14  # shift register
  for (N = w4) (iteration -> i3) {
    Array Index(array=s5) -> (out0[i3, i3]=w15)
    Multiply(w15, 0.5+0i) -> w16
    Replace Array Subset(inArray=s5, i3, i3, w16) -> w17
    next s5 = w17
  }
  Initialize Array(element=0+0i, size=w2, size=w1) -> w18
  Replace Array Subset(inArray=w18, 0, 0, s5) -> w19
  $"Toeplitz Array" <- w19
