vi "student_sliding_correlator.gvi"   [LabVIEW NXG]
inputs:
  "Modulation Parameters": T6 = {"Modulation Type"="QPSK", "Control Information\nfor Packet Header/Tail"={"Training Sequence (derived)"=[], "Zero Pad Length"=0}, "RX oversample factor"=20, "Synchronization Options"={"Synchronization Method"="Timing Estimation", "Fixed Offset"=0, "Symbol Timing Recovery Method"="Max Energy", "Frame Detection Method"="Sliding Correlator", "Correct Frequency Offset"=FALSE}, "Number of Data Symbols (Derived)"=100, "RX Sample Rate"=4000000, "Pulse Shaping Parameters"={"Modulation Type"="PSK", "Pulse Shaping Filter"="Root Raised Cos", "Filter Parameter"=0.5, "Filter Length (Symbols)"=8}, "Channel Estimation/Equalization Parameters"={"Equalization Method"="Direct", "channel estimate length"=1, "equalizer length"=1, "equalizer delay"=-1}}
  "Input Complex Waveform": cluster{"t0": f64, "dt": f64, "Y": c128[]} = {"t0"=0, "dt"=1, "Y"=[]}
  "error in (no error)": error
outputs:
  "Output": c128[]
  "Frame Offset": i32
  "Frequency Offset": f64
  "error out": error
panel indicators:
  "size(s)": i32
  "size(s)_2": i32
  "size(s)_3": i32
types:
  T1 = cluster{"Training Sequence (derived)": c128[], "Zero Pad Length": i32}
  T2 = cluster{"Synchronization Method": string, "Fixed Offset": i32, "Symbol Timing Recovery Method": string, "Frame Detection Method": string, "Correct Frequency Offset": bool}
  T3 = enum{"none", "Raised Cosine", "Root Raised Cos", "Gaussian"}
  T4 = cluster{"Modulation Type": enum{"FSK", "PSK", "QAM", "MSK", "PAM", "ASK"}, "Pulse Shaping Filter": T3, "Filter Parameter": f64, "Filter Length (Symbols)": i32}
  T5 = cluster{"Equalization Method": string, "channel estimate length": i32, "equalizer length": i32, "equalizer delay": i32}
  T6 = cluster{"Modulation Type": string, "Control Information\nfor Packet Header/Tail": T1, "RX oversample factor": i32, "Synchronization Options": T2, "Number of Data Symbols (Derived)": i32, "RX Sample Rate": f64, "Pulse Shaping Parameters": T4, "Channel Estimation/Equalization Parameters": T5}
diagram:
  Property Node(instance in=$"Input Complex Waveform") -> ("Y"=w1)
  Array Size(array=w1) -> (size(s)=w2)
  $"size(s)" <- w2
  Property Node(instance in=$"Modulation Parameters") -> ("Control Information\nfor Packet Header/Tail:Training Sequence (derived)"=w3, "Synchronization Options:Correct Frequency Offset"=w4)
  Complex Conjugate(x + iy=w3) -> w5
  call "1D Cross Correlation (CDB).gvi"(x=w1, y=w5) -> (rxy=w6)
  Absolute Value(x=w6) -> w7
  Square(x=w7) -> w8
  Array Max And Min(array=w8) -> (max index(es)=w9)
  Subtract(x=w2, y=w9) -> w10
  Decrement(x=w10) -> w11
  s1 = w1  # shift register
  for (N = w11) {
    Replace Array Subset(inArray=s1, 0, 0+0i) -> w12
    Rotate 1D Array(array=w12, n=-1) -> (array (last n elements first)=w13)
    next s1 = w13
  }
  case (w4) {
    frame False, Default {
      w14 = s1
      w15 = 0
      w16 = $"error in (no error)"
    }
    frame True {
      call "moose.gviprotected"(Modulation Parameters=$"Modulation Parameters", input=s1) -> (output=w14, frequency offset=w15)
      w16 = $"error in (no error)"
    }
  }
  $Output <- w14
  $"Frequency Offset" <- w15
  Array Size(array=w5) -> (size(s)=w17)
  $"size(s)_2" <- w17
  Array Size(array=w8) -> (size(s)=w18)
  # comment
  $"size(s)_3" <- w18
  $"Frame Offset" <- w11
  $"error out" <- w16
