vi "student_moose.gvi"   [LabVIEW NXG]
inputs:
  "Modulation Parameters": T6 = {"Modulation Type"="QPSK", "Control Information\nfor Packet Header/Tail"={"Training Sequence (derived)"=[], "Zero Pad Length"=0}, "RX Oversample Factor"=20, "Synchronization Options"={"Synchronization Method"="Timing Estimation", "Fixed Offset"=0, "Symbol Timing Recovery Method"="Max Energy", "Frame Detection Method"="Sliding Correlator", "Correct Frequency Offset"=FALSE}, "Number of Data Symbols (Derived)"=100, "RX Sample Rate"=4000000, "Pulse Shaping Parameters"={"Modulation Type"="PSK", "Pulse Shaping Filter"="Root Raised Cos", "Filter Parameter"=0.5, "Filter Length (Symbols)"=8}, "Channel Estimation/Equalization Parameters"={"Equalization Method"="Direct", "Channel Estimate Length"=1, "Equalizer Length"=1, "Equalizer Delay"=-1}}
  "Input": c128[]
  "Error In": error
outputs:
  "Error Out": error
  "Output": c128[]
  "Frequency Offset": f64
types:
  T1 = cluster{"Training Sequence (derived)": c128[], "Zero Pad Length": i32}
  T2 = cluster{"Synchronization Method": string, "Fixed Offset": i32, "Symbol Timing Recovery Method": string, "Frame Detection Method": string, "Correct Frequency Offset": bool}
  T3 = enum{"none", "Raised Cosine", "Root Raised Cos", "Gaussian"}
  T4 = cluster{"Modulation Type": enum{"FSK", "PSK", "QAM", "MSK", "PAM", "ASK"}, "Pulse Shaping Filter": T3, "Filter Parameter": f64, "Filter Length (Symbols)": i32}
  T5 = cluster{"Equalization Method": string, "Channel Estimate Length": i32, "Equalizer Length": i32, "Equalizer Delay": i32}
  T6 = cluster{"Modulation Type": string, "Control Information\nfor Packet Header/Tail": T1, "RX Oversample Factor": i32, "Synchronization Options": T2, "Number of Data Symbols (Derived)": i32, "RX Sample Rate": f64, "Pulse Shaping Parameters": T4, "Channel Estimation/Equalization Parameters": T5}
diagram:
  Property Node(instance in=$"Modulation Parameters") -> ("RX Sample Rate"=w1, "Channel Estimation/Equalization Parameters:Channel Estimate Length"=w2, "Control Information\nfor Packet Header/Tail:Training Sequence (derived)"=w3)
  Array Size(array=w3) -> (size(s)=w4)
  Subtract(x=w4, y=w2) -> w5
  Decrement(x=w5) -> w6
  s1 = 0+0i  # shift register
  for (N = w6) (iteration -> i1) {
    Add(w2, i1) -> w7
    Add(w4, w7) -> w8
    Array Index(array=$Input) -> (out0[w8]=w9)
    Array Index(array=$Input) -> (out0[w7]=w10)
    Complex Conjugate(x + iy=w10) -> w11
    Multiply(w11, w9) -> w12
    next s1 = w12
  }
  Multiply(2, Pi) -> w13
  Multiply(w4, w13) -> w14
  Divide(x=s1, y=w14) -> w15
  Multiply(w1, w15) -> w16
  Complex To Polar(r * e^(i*theta)=w16) -> (theta=w17)
  $"Frequency Offset" <- w17
  # epsilon
  Complex To Polar(r * e^(i*theta)=w15) -> (theta=w18)
  Multiply(0-2i, w18) -> w19
  Multiply(Pi, w19) -> w20
  for (iteration -> i2) {
    w21 = each element of $Input
    Multiply(w20, i2) -> w23
    Exponential(x=w23) -> w24
    Multiply(w21, w24) -> w25
    append w25 to w22
  }
  $Output <- w22
  $"Error Out" <- $"Error In"
