vi "student_sliding_correlator (1).gvi"   [LabVIEW NXG]
inputs:
  "Modulation Parameters": T6 = {"Modulation Type"="QPSK", "Control Information\nfor Packet Header/Tail"={"Training Sequence (derived)"=[], "Zero Pad Length"=0}, "RX oversample factor"=20, "Synchronization Options"={"Synchronization Method"="Timing Estimation", "Fixed Offset"=0, "Symbol Timing Recovery Method"="Max Energy", "Frame Detection Method"="Sliding Correlator", "Correct Frequency Offset"=FALSE}, "Number of Data Symbols (Derived)"=100, "RX Sample Rate"=4000000, "Pulse Shaping Parameters"={"Modulation Type"="PSK", "Pulse Shaping Filter"="Root Raised Cos", "Filter Parameter"=0.5, "Filter Length (Symbols)"=8}, "Channel Estimation/Equalization Parameters"={"Equalization Method"="Direct", "channel estimate length"=1, "equalizer length"=1, "equalizer delay"=-1}}
  "Input Complex Waveform": cluster{"t0": f64, "dt": f64, "Y": c128[]} = {"t0"=0, "dt"=1, "Y"=[]}
  "error in (no error)": error
outputs:
  "Output": c128[]
  "Frame Offset": i32
  "Frequency Offset": f64
  "error out": error
panel indicators:
  "size(s)": i32
types:
  T1 = cluster{"Training Sequence (derived)": c128[], "Zero Pad Length": i32}
  T2 = cluster{"Synchronization Method": string, "Fixed Offset": i32, "Symbol Timing Recovery Method": string, "Frame Detection Method": string, "Correct Frequency Offset": bool}
  T3 = enum{"none", "Raised Cosine", "Root Raised Cos", "Gaussian"}
  T4 = cluster{"Modulation Type": enum{"FSK", "PSK", "QAM", "MSK", "PAM", "ASK"}, "Pulse Shaping Filter": T3, "Filter Parameter": f64, "Filter Length (Symbols)": i32}
  T5 = cluster{"Equalization Method": string, "channel estimate length": i32, "equalizer length": i32, "equalizer delay": i32}
  T6 = cluster{"Modulation Type": string, "Control Information\nfor Packet Header/Tail": T1, "RX oversample factor": i32, "Synchronization Options": T2, "Number of Data Symbols (Derived)": i32, "RX Sample Rate": f64, "Pulse Shaping Parameters": T4, "Channel Estimation/Equalization Parameters": T5}
diagram:
  Property Node(instance in=$"Input Complex Waveform") -> ("Y"=w1)
  Array Size(array=w1) -> (size(s)=w2)
  $"size(s)" <- w2
  Property Node(instance in=$"Modulation Parameters") -> ("Control Information\nfor Packet Header/Tail:Training Sequence (derived)"=w3, "Synchronization Options:Correct Frequency Offset"=w4)
  call "1D Cross Correlation (CDB).gvi"(x=w1, y=w3) -> (rxy=w5)
  Absolute Value(x=w5) -> w6
  Array Max And Min(array=w6) -> (max index(es)=w7)
  Subtract(x=w2, y=w7) -> w8
  Decrement(x=w8) -> w9
  Negate(x=w9) -> w10
  Rotate 1D Array(array=w1, n=w10) -> (array (last n elements first)=w11)
  case (w4) {
    frame False, Default {
      w12 = w11
      w13 = 0
      w14 = $"error in (no error)"
    }
    frame True {
      call "moose.gviprotected"(Modulation Parameters=$"Modulation Parameters", input=w11) -> (output=w12, frequency offset=w13)
      w14 = $"error in (no error)"
    }
  }
  $Output <- w12
  $"Frequency Offset" <- w13
  $"Frame Offset" <- w9
  $"error out" <- w14
