vi "student_sliding_correlator.gvi"   [LabVIEW NXG]
inputs:
  "Modulation Parameters": T6 = {"Modulation Type"="QPSK", "Control Information\nfor Packet Header/Tail"={"Training Sequence (derived)"=[], "Zero Pad Length"=0}, "RX oversample factor"=20, "Synchronization Options"={"Synchronization Method"="Timing Estimation", "Fixed Offset"=0, "Symbol Timing Recovery Method"="Max Energy", "Frame Detection Method"="Sliding Correlator", "Correct Frequency Offset"=FALSE}, "Number of Data Symbols (Derived)"=100, "RX Sample Rate"=4000000, "Pulse Shaping Parameters"={"Modulation Type"="PSK", "Pulse Shaping Filter"="Root Raised Cos", "Filter Parameter"=0.5, "Filter Length (Symbols)"=8}, "Channel Estimation/Equalization Parameters"={"Equalization Method"="Direct", "channel estimate length"=1, "equalizer length"=1, "equalizer delay"=-1}}
  "Input Complex Waveform": cluster{"t0": f64, "dt": f64, "Y": c128[]} = {"t0"=0, "dt"=1, "Y"=[]}
  "error in (no error)": error
outputs:
  "Output": c128[]
  "Frame Offset": i32
  "Frequency Offset": f64
  "error out": error
types:
  T1 = cluster{"Training Sequence (derived)": c128[], "Zero Pad Length": i32}
  T2 = cluster{"Synchronization Method": string, "Fixed Offset": i32, "Symbol Timing Recovery Method": string, "Frame Detection Method": string, "Correct Frequency Offset": bool}
  T3 = enum{"none", "Raised Cosine", "Root Raised Cos", "Gaussian"}
  T4 = cluster{"Modulation Type": enum{"FSK", "PSK", "QAM", "MSK", "PAM", "ASK"}, "Pulse Shaping Filter": T3, "Filter Parameter": f64, "Filter Length (Symbols)": i32}
  T5 = cluster{"Equalization Method": string, "channel estimate length": i32, "equalizer length": i32, "equalizer delay": i32}
  T6 = cluster{"Modulation Type": string, "Control Information\nfor Packet Header/Tail": T1, "RX oversample factor": i32, "Synchronization Options": T2, "Number of Data Symbols (Derived)": i32, "RX Sample Rate": f64, "Pulse Shaping Parameters": T4, "Channel Estimation/Equalization Parameters": T5}
diagram:
  Property Node(instance in=$"Modulation Parameters") -> ("Control Information\nfor Packet Header/Tail:Training Sequence (derived)"=w1, "Synchronization Options:Correct Frequency Offset"=w2)
  Property Node(instance in=$"Input Complex Waveform") -> ("Y"=w3)
  Array Size(array=w3) -> (size(s)=w4)
  Array Size(array=w1) -> (size(s)=w5)
  Subtract(x=w4, y=w5) -> w6
  for (N = w6) (iteration -> i1) {
    s1 = 0  # shift register
    for (iteration -> i2) {
      w8 = each element of w1
      Complex Conjugate(x + iy=w8) -> w9
      Add(i1, i2) -> w10
      Array Index(array=w3) -> (out0[w10]=w11)
      Multiply(w11, w9) -> w12
      Complex To Polar(r * e^(i*theta)=w12) -> (r=w13)
      Square(x=w13) -> w14
      next s1 = w14
    }
    append s1 to w7
  }
  Array Max And Min(array=w7) -> (max index(es)=w15)
  Subtract(x=w4, y=w15) -> w16
  Array Subset(array=w3, index0=w15, length0=w16) -> w17
  case (w2) {
    frame False, Default {
      w18 = w17
      w19 = 0
    }
    frame True {
      call "moose.gviprotected"(Modulation Parameters=$"Modulation Parameters", input=w17) -> (output=w18, frequency offset=w19)
    }
  }
  $Output <- w18
  $"Frequency Offset" <- w19
  $"Frame Offset" <- w15
  $"error out" <- $"error in (no error)"
