vi "student_OFDM_SchmidlCox.gvi"   [LabVIEW NXG]
inputs:
  "Modulation Parameters": T7 = {"Control Information\nfor Packet Header/Tail"={"Training Sequence Type"="IEEE 802.11a Short", "Training Sequence (derived)"=[], "Zero Pad Length"=0}, "RX Oversample Factor"=20, "Synchronization Options"={"Synchronization Method"="Timing Estimation", "Fixed Offset"=0, "Symbol Timing Recovery Method"="Max Energy", "Frame Detection Method"="Sliding Correlator", "Correct Frequency Offset"=FALSE}, "Number of Data Symbols (Derived)"=100, "RX Sample Rate"=4000000, "Pulse Shaping Parameters"={"Modulation Type"="PSK", "Pulse Shaping Filter"="Root Raised Cos", "Filter Parameter"=0.5, "Filter Length (Symbols)"=8}, "Channel Estimation/Equalization Parameters"={"Equalization Method"="Direct", "Channel Estimate Length"=1, "Equalizer Length"=1, "Equalizer Delay"=-1}, "Equalize Channel"=FALSE, "Modulation Type"="QPSK"}
  "Input Complex Waveform": cluster{"t0": f64, "dt": f64, "Y": c128[]} = {"t0"=0, "dt"=1, "Y"=[]}
  "OFDM Parameters": T1 = {"FFT size (N)"=64, "Length of CP (Lc)"=8, "Null Tones"=[0, 30, 31, 32], "Number of OFDM Symbols (derived)"=1, "Training Sequence FFT size"=0, "Training Sequence Length of CP"=0}
  "error in (no error)": error
  "Epsilon": f64 = 0.1
outputs:
  "output": c128[]
  "frame offset": i32
  "frequency offset": f64
  "error out": error
panel indicators:
  "theta": f64
types:
  T1 = cluster{"FFT size (N)": i32, "Length of CP (Lc)": i32, "Null Tones": u32[], "Number of OFDM Symbols (derived)": i32, "Training Sequence FFT size": i32, "Training Sequence Length of CP": i32}
  T2 = cluster{"Training Sequence Type": string, "Training Sequence (derived)": c128[], "Zero Pad Length": i32}
  T3 = cluster{"Synchronization Method": string, "Fixed Offset": i32, "Symbol Timing Recovery Method": string, "Frame Detection Method": string, "Correct Frequency Offset": bool}
  T4 = enum{"none", "Raised Cosine", "Root Raised Cos", "Gaussian"}
  T5 = cluster{"Modulation Type": enum{"FSK", "PSK", "QAM", "MSK", "PAM", "ASK"}, "Pulse Shaping Filter": T4, "Filter Parameter": f64, "Filter Length (Symbols)": i32}
  T6 = cluster{"Equalization Method": string, "Channel Estimate Length": i32, "Equalizer Length": i32, "Equalizer Delay": i32}
  T7 = cluster{"Control Information\nfor Packet Header/Tail": T2, "RX Oversample Factor": i32, "Synchronization Options": T3, "Number of Data Symbols (Derived)": i32, "RX Sample Rate": f64, "Pulse Shaping Parameters": T5, "Channel Estimation/Equalization Parameters": T6, "Equalize Channel": bool, "Modulation Type": string}
diagram:
  Property Node(instance in=$"Modulation Parameters") -> ("Control Information\nfor Packet Header/Tail:Training Sequence (derived)"=w1, "Control Information\nfor Packet Header/Tail:Zero Pad Length"=w2, "Synchronization Options:Correct Frequency Offset"=w3)
  Property Node(instance in=$"OFDM Parameters") -> ("Training Sequence FFT size"=w4, "Training Sequence Length of CP"=w5)
  Property Node(instance in=$"Input Complex Waveform") -> ("Y"=w6)
  Array Subset(array=w6, index0=w2) -> w7
  Array Size(array=w1) -> (size(s)=w8)
  # W
  Quotient And Remainder(x=w8, y=2) -> (floor(x/y)=w9)
  Add(w9, w5) -> w10
  # P[d]
  # R[d]
  for (N = w10) (iteration -> i1) {
    # d
    for (N = w4) (iteration -> i2) {
      # n+d
      # n
      Add(i2, i1) -> w15
      Add(w15, w9) -> w16
      # y[n+d+W]
      Array Index(array=w7) -> (out0[w16]=w17)
      # y[n+d]
      Array Index(array=w7) -> (out0[w15]=w18)
      Complex Conjugate(x + iy=w18) -> w19
      Multiply(w19, w17) -> w20
      Absolute Value(x=w17) -> w21
      Square(x=w21) -> w22
      append w20 to w13
      append w22 to w14
    }
    Add Array Elements(numeric array=w13) -> (sum=w23)
    Add Array Elements(numeric array=w14) -> (sum=w24)
    append w23 to w11
    append w24 to w12
  }
  Divide(x=w11, y=w12) -> w25
  Absolute Value(x=w25) -> w26
  Square(x=w26) -> w27
  Array Max And Min(array=w27) -> (max index(es)=w28)
  Add(w2, w28) -> w29
  $"frame offset" <- w29
  Reciprocal(x=w25) -> w30
  Array Index(array=w30) -> (out0[w29]=w31)
  Complex To Polar(r * e^(i*theta)=w31) -> (theta=w32)
  $theta <- w32
  Array Subset(array=w6, index0=w29) -> w33
  case (w3) {
    frame False, Default {
      w34 = 0
      w35 = w33
    }
    frame True {
      call "moose.gviprotected"(Modulation Parameters=$"Modulation Parameters", input=w33) -> (output=w35, frequency offset=w34)
    }
  }
  $output <- w35
  $"frequency offset" <- w34
  $"error out" <- $"error in (no error)"
