vi "top_ofdm_rx.gvi"   [LabVIEW NXG]
inputs:
  "HW Parameters": T1 = {"Device IP Address"="192.168.10.2", "Active Antenna"="RX1", "Carrier Frequency (Hz)"=915000000, "Gain (dB)"=10, "Trigger Level"=0.01, "Bandwidth (Hz)"=39600000, "Reference Position (%)"=10, "Capture Time (sec)"=0.00032, "Simulate"=FALSE}
  "Modulation Parameters": T9 = {"Control Information\nfor Packet Header/Tail"={"Training Sequence Type"="IEEE 802.11a Short", "Training Sequence (derived)"=[], "Zero Pad Length"=8}, "RX Oversample Factor"=10, "Synchronization Options"={"Synchronization Method"="OFDM Synchronization", "Fixed Offset"=0, "Symbol Timing Recovery Method"="Max Energy", "Frame Detection Method"="OFDM Frame & Frequency Sync", "Correct Frequency Offset"=FALSE}, "Number of Data Symbols (Derived)"=250, "RX Sample Rate"=20000000, "Pulse Shaping Parameters"={"Modulation Type"="PSK", "Pulse Shaping Filter"="Raised Cosine", "Filter Parameter"=0.5, "Filter Length (Symbols)"=8}, "Channel Estimation/Equalization Parameters"={"Equalization Method"="Direct", "Channel Estimate Length"=4, "Equalizer Length"=4, "Equalizer Delay"=-1}, "Equalize Channel"=TRUE, "Modulation Type"="QPSK"}
  "error in": error
  "Received IQ Waveform": cluster{"t0": f64, "dt": f64, "Y": c128[]}
  "OFDM Parameters": T3 = {"FFT size (N)"=64, "Length of CP (Lc)"=8, "Null Tones"=[0, 30, 31, 32], "Number of OFDM Symbols (derived)"=1, "Training Sequence FFT size"=64, "Training Sequence Length of CP"=8}
  "# of Receive Iterations": i32 = 1
  "Queues": T10
outputs:
  "error out": error
  "Measured Channel Impairements": T2
  "Offset": i32
  "Received Constellation": cluster{"Element 1": f64[], "Element 2": f64[]}[]
  "Eye Diagram": cluster{"t0": f64, "dt": f64, "Y": f64[]}[]
  "Q Data": waveform<f64>
  "I Data": waveform<f64>
  "Power Delay Profile": waveform<f64>
  "Average Bit-Error Rate": f64
panel controls:
  "Stop": bool
  "Parameters": i32
  "Plots": i32
panel indicators:
  "Packet Detected": bool
  "Bit-Error Rate": f64
  "Coerced Bandwidth": f64
  "Coerced Carrier Frequency (Hz)": f64
  "Coerced Gain (dB)": f64
  "Key Bit Sequence": u8[]
  "Overhead Offset": i32
  "Symbol Rate": f64
  "Channel Response": cluster{"Element 1": f64, "Element 2": f64}[]
types:
  T1 = cluster{"Device IP Address": string, "Active Antenna": string, "Carrier Frequency (Hz)": f64, "Gain (dB)": f64, "Trigger Level": f64, "Bandwidth (Hz)": f64, "Reference Position (%)": f64, "Capture Time (sec)": f64, "Simulate": bool}
  T2 = cluster{"SNR(dB)": f64, "Channel Estimate": c128[], "Freq. Offset": f64, "Delay": f64}
  T3 = cluster{"FFT size (N)": i32, "Length of CP (Lc)": i32, "Null Tones": u32[], "Number of OFDM Symbols (derived)": i32, "Training Sequence FFT size": i32, "Training Sequence Length of CP": i32}
  T4 = cluster{"Training Sequence Type": string, "Training Sequence (derived)": c128[], "Zero Pad Length": i32}
  T5 = cluster{"Synchronization Method": string, "Fixed Offset": i32, "Symbol Timing Recovery Method": string, "Frame Detection Method": string, "Correct Frequency Offset": bool}
  T6 = enum{"none", "Raised Cosine", "Root Raised Cos", "Gaussian"}
  T7 = cluster{"Modulation Type": enum{"FSK", "PSK", "QAM", "MSK", "PAM", "ASK"}, "Pulse Shaping Filter": T6, "Filter Parameter": f64, "Filter Length (Symbols)": i32}
  T8 = cluster{"Equalization Method": string, "Channel Estimate Length": i32, "Equalizer Length": i32, "Equalizer Delay": i32}
  T9 = cluster{"Control Information\nfor Packet Header/Tail": T4, "RX Oversample Factor": i32, "Synchronization Options": T5, "Number of Data Symbols (Derived)": i32, "RX Sample Rate": f64, "Pulse Shaping Parameters": T7, "Channel Estimation/Equalization Parameters": T8, "Equalize Channel": bool, "Modulation Type": string}
  T10 = cluster{"Key Bit Sequence Queue In": Queue<u8[]>, "Training Sequence Queue In": Queue<c128[]>}
diagram:
  case ($"error in") {
    frame No Error {
      sequence {
        frame 0 {
          # Initialize RF Hardware
          $"Packet Detected" <- FALSE
          call "RXRF_init.gvi"(HW Parameters In=$"HW Parameters", Modulation Parameters In=$"Modulation Parameters", error in (no error)=$"error in") -> (error out=w2, Modulation Parameters Out=w3, HW Parameters Out=w4, Queues out=w5, USRP Session out=w6)
        }
        frame 1 {
          while (iteration -> i1) {
            $"Packet Detected" <- FALSE
            # simulate?
            call "RXRF_config.gvi"(HW Parameters In=w4, USRP Session In=w6, Queues in=w5, Modulation Parameters In=w3, error in (no error)=w2) -> (HW Parameters Out=w8, Modulation Parameters Out=w9, Simulate=w10, Queues out=w11, error out=w12, USRP Session Out=w13, Coerced Carrier Frequency (Hz)=w14, Coerced Bandwidth=w15, Coerced Gain (dB)=w16)
            # Configure RF for acquisition
            case (w10) {
              frame False, Default {
                call "RXRF_recv.gvi"(USRP Session In=w13, HW Parameters In=w8, Modulation Parameters In=w9, error in (no error)=w12, Queues in=w11) -> (Packet Detected=w20, USRP Session Out=w19, HW Parameters Out=w21, Modulation Parameters Out=w22, error out=w18, Received IQ waveform=w24, Queues out=w23)
                Property Node(instance in=w22) -> ("RX Sample Rate"=w25)
                call "MT Resample (Complex Cluster).gvi"(input complex waveform=w24, desired sample rate=w25) -> (output complex waveform=w17)
              }
              frame True {
                Property Node(instance in=w9) -> ("RX Sample Rate"=w26)
                call "MT Resample (Complex Cluster).gvi"(input complex waveform=$"Received IQ Waveform", desired sample rate=w26) -> (output complex waveform=w17)
                w18 = w12
                w19 = w13
                w20 = TRUE
                w21 = w8
                w22 = w9
                w23 = w11
              }
            }
            # Acquire if trigger level exceeded
            case (w20) {
              frame False, Default {
                w27 = w18
                w28 = w19
                w29 = 0
                w30 = w23
                w31 = w21
              }
              frame True {
                call "reveciver_plot_IQ (SubVI).gvi"(Received IQ waveform=w17, error in=w18) -> (Q=w32, I=w33, error out=w34)
                call "OFDM_receiver.gvi"(error in (no error)=w34, HW Parameters In=w21, Modulation Parameters In=w22, Queues In=w23, Input Complex Waveform=w17, OFDM Parameters In=$"OFDM Parameters") -> (error out=w27, Overhead Offset=w35, Bit-Error Rate=w29, Measured Channel Impairements=w36, Key Bit Sequence=w37, Offset=w38, HW Parameters Out=w31, Queues Out=w30, RX Waveforms Out=w39)
                $"Overhead Offset" <- w35
                $"Packet Detected" <- TRUE
                # Plot I and Q phases of received signal
                $"Q Data" <- w32
                Property Node(instance in=w39) -> ("IQ Graph"=w40, "Eye Diagram"=w41, "Power Delay Profile"=w42, "Magnitude Response"=w43)
                $"Received Constellation" <- w40
                $"I Data" <- w33
                $"Eye Diagram" <- w41
                $"Power Delay Profile" <- w42
                $"Channel Response" <- w43
                $Offset <- w38
                $"Key Bit Sequence" <- w37
                Property Node(instance in=w22) -> ("RX Sample Rate"=w44, "RX Oversample Factor"=w45)
                Divide(x=w44, y=w45) -> w46
                $"Symbol Rate" <- w46
                $"Measured Channel Impairements" <- w36
                w28 = w19
              }
            }
            $"Bit-Error Rate" <- w29
            $"Coerced Gain (dB)" <- w16
            $"Coerced Bandwidth" <- w15
            $"Coerced Carrier Frequency (Hz)" <- w14
            $"error out" <- w27
            Increment(x=i1) -> w47
            Is Equal(x=$"# of Receive Iterations", y=w47) -> w48
            Logical Or(w27, $Stop, w48) -> w49
            append w29 to w7
            stop if w49
          }
          call "Mean (DBL).gvi"(X=w7) -> (mean=w50)
          $"Average Bit-Error Rate" <- w50
        }
        frame 2 {
          # Close USRP session
          $"Packet Detected" <- FALSE
          call "RXRF_close (SubVI).gvi"(HW Parameters In=w31, error in=w27, Queues In=w30, USRP Session=w28) -> (error out=w1)
        }
      }
    }
    frame Error {
      w1 = $"error in"
    }
  }
  $"error out" <- w1
